# Grasshopper definition Recon_Clustering.gh (Grasshopper 1.0.8)
# plug-ins: RhinoCodePluginGH

crv = Curve([<curve referenced from the Rhino model> x35])
number_slider = Slider(4, range=0..10)
lng = ListLength(List=crv)
pln = Plane(crv)
line = Line(crv)
series = Series(Start=0, Step=1, Count=lng)
rectangle = Rectangle(Plane=pln, XSize=Domain(-1, 1), YSize=Domain(-1, 1), Radius=0)  # -> Rectangle, Length
ext = ExtendCurve(Curve=line, Type=0, Start=number_slider, End=number_slider)
end = EndPoints(Curve=graft(line))  # -> Start, End
end_2 = EndPoints(Curve=graft(ext))  # -> Start, End
concat = Concatenate(FragmentA="P", FragmentB=series)
extr = Extrude(Base=rectangle.Rectangle, Direction=line)
merge = Merge(Data1=end.Start, Data2=end.End)
merge_2 = Merge(Data1=end_2.Start, Data2=end_2.End)
cap = CapHoles(Brep=extr)
pt = Point(simplify(merge))
brepsinc = PointInBreps(Brep=cap, Point=merge, Strict=invert(False))  # -> Inside, Index
brepsinc_2 = PointInBreps(Brep=cap, Point=merge_2, Strict=invert(False))  # -> Inside, Index
item = ListItem(List=concat, Index=brepsinc.Index, Wrap=invert(True))  # -> simplify(Item)
item_2 = ListItem(List=concat, Index=brepsinc_2.Index, Wrap=invert(True))  # -> simplify(Item)
txt = Text(pt)
panel = Panel(item)
py3 = Python3Script(parts=simplify(graft(concat)), connections=item, collisions=item_2)  # -> graph, gml; inputs parts: tree, connections: tree, collisions: tree
# ---------- py3: Python ----------
# venv: recongraph
# r: recongraph @ git+https://github.com/ArdooTala/Recon_Clustering.git@main

import networkx as nx
from ghpythonlib import treehelpers as th


a = th.tree_to_list(parts, None)
b = th.tree_to_list(connections, None)
c = th.tree_to_list(collisions, None)

graph = nx.DiGraph()

for part in a:
    graph.add_node(part[0], TYPE="PART")

for part, conns, colls in zip(a, b, c):
    part = part[0]

    for con, col in zip(conns, colls):
        if not con:
            continue
        connection_node = f"{part}-{con}"

        graph.add_node(connection_node, TYPE="CONN")
        graph.add_edge(part, connection_node, EDGE_TYPE="CONN")
        graph.add_edge(con, connection_node, EDGE_TYPE="CONN")

        if not col:
            continue
        graph.add_edge(connection_node, col, EDGE_TYPE="COLL")

print(graph)
print(graph.nodes)
gml = "\n".join(nx.generate_gml(graph))
# ---------- end py3 ----------
panel_2 = Panel(item_2)
panel_3 = Panel(py3.graph)
panel_4 = Panel(py3.gml)
py3_2 = Python3Script(graph=py3.graph)  # -> out, stages_parts, stages_connections
# ---------- py3_2: Python ----------
# venv: recongraph
# r: recongraph @ git+https://github.com/ArdooTala/Recon_Clustering.git@main

from ghpythonlib import treehelpers as th
from recongraph.processors import graph_solver, graph_parser
from pprint import pprint


print(graph)

res = graph_solver.direct_cluster_sccs(graph)
print(res)
print(res.nodes)

res_xpn = graph_solver.expand_clusters(res)
print(res_xpn)
print(res_xpn.nodes)

res_con = graph_solver.convert_ass_dep_to_con_dep(res_xpn)
print(res_con)
print(res_con.nodes)

stages_dict = graph_parser.generate_stages(graph, res_con)
pprint(stages_dict)

stages_part_list = []
stages_conn_list = []
for stg in stages_dict:
    stg_part_comps = []
    stg_conn_comps = []
    for comp in stages_dict[stg]:
        stg_part_comps.append(list(stages_dict[stg][comp]['group']))
        stg_conn_comps.append(list(stages_dict[stg][comp]['conns']))
    stages_part_list.append(stg_part_comps)
    stages_conn_list.append(stg_conn_comps)

stages_parts = th.list_to_tree(stages_part_list, source=[0])
stages_connections = th.list_to_tree(stages_conn_list, source=[0])
# ---------- end py3_2 ----------
mindex = MemberIndex(Set=concat, Member=py3_2.stages_parts)  # -> Index, Count
panel_5 = Panel(py3_2.stages_parts)
trim = TrimTree(Tree=mindex.Index, Depth=1)
item_3 = ListItem(List=cap, Index=trim, Wrap=True)
viewer = ParamViewer(panel_5)
bang = ExplodeTree(Data=item_3)  # -> Branch0, Branch1, Branch2, Branch3, Branch4, Branch5, Branch6, Branch7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
geo = Geometry(bang.Branch14)
